# Grasshopper definition 00_LDM_3DP_Components_240811.gh (Grasshopper 1.0.8)
# plug-ins: RhinoCodePluginGH, LadybugGrasshopper

data = Data(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)
infill_mesh = Data(data)
bbox = BoundingBox(Content=data, Plane=PlaneXY(0, 0, 0), UnionBox=True)  # -> Box, Box_2
debox = DeconstructBox(Box=bbox.Box_2)  # -> Plane, X, Y, Z
py3 = DomainLength(domain=debox.Z)  # -> out, domain_length
# ---------- py3: Python ----------
ghenv.Component.Name = "DomainLength"
ghenv.Component.Message = "DomainLength"

import Rhino.Geometry as rg

# Check if the input is a valid domain (Interval)
if isinstance(domain, rg.Interval):
    domain_length = domain.Length
else:
    domain_length = None
    print("The input is not a valid domain.")
# ---------- end py3 ----------
component_height_z = Data(py3.domain_length)
layer_height = Panel("1.5")
nozzle_diam = Panel("3")
nozzle_diam_2 = Number(nozzle_diam)
bbox_2 = BoundingBox(Content=flatten(infill_mesh), Plane=PlaneXY(0, 0, 0), UnionBox=True)  # -> Box, Box_2
debox_2 = DeconstructBox(Box=bbox_2.Box)  # -> Plane, X, Y, Z
py3_2 = DomainLength(domain=debox_2.X)  # -> out, domain_length; same code as py3
nozzle_diam_3 = Number(nozzle_diam_2)
division = Division(A=nozzle_diam_3, B=py3_2.domain_length)
scale_nu = ScaleNU(Geometry=bbox_2.Box, Plane=PlaneXY(0, 0, 0), ScaleX=expr("x+1", division), ScaleY=expr("x+1", division), ScaleZ=1)  # -> Geometry, Transform
component_height_z_2 = Data(component_height_z)
layer_height_2 = Data(layer_height)
debrep = DeconstructBrep(Brep=scale_nu.Geometry)  # -> Faces, Edges, Vertices
panel = Panel("""4
5""")
division_2 = Division(A=component_height_z_2, B=layer_height_2)
cull_i = CullIndex(List=debrep.Faces, Indices=panel, Wrap=True)
round = Round(Number=division_2)  # -> Nearest, Floor, Ceiling
item = ListItem(List=debrep.Vertices, Index=0, Wrap=True)
data_2 = Data(infill_mesh)
join = BrepJoin(Breps=cull_i)  # -> Breps, Closed
series = Series(Start=layer_height_2, Step=layer_height_2, Count=round.Floor)
pln = Plane(item)
Z = UnitZ(Factor=series)
move = Move(Geometry=pln, Motion=Z)  # -> Geometry, Transform
sec = MeshPlane(Mesh=data_2, Plane=move.Geometry)  # -> simplify(Curves)

tree = Data()
tstat = TreeStatistics(Tree=tree)  # -> Paths, Length, Count
item_2 = ListItem(List=tstat.Paths, Index=Slider(0, range=0..44), Wrap=invert(True))
branch = TreeBranch(Tree=tree, Path=item_2, MaintainPaths=True)

join_2 = JoinCurves(Curves=sec, Preserve=False)
crvs = Curve(join_2)

# ----
# Remove too short curves
crv = Curve(crvs)
len = Length(Curve=crv)
smaller = SmallerThan(FirstNumber=len, SecondNumber="4")  # -> SmallerThan, OrEqualTo
cull = CullPattern(List=crv, CullPattern=invert(smaller.SmallerThan))
crv_2 = Curve(cull)

# ----
# Module
item_3 = ListItem(List=branch, Index=0, Wrap=True)

# ----
# Flip to same direction
crv_3 = Curve(crv_2)
end = EndPoints(Curve=crv_3)  # -> Start, End
bbox_3 = BoundingBox(Content=crv_3, Plane=PlaneXY(0, 0, 0), UnionBox=True)  # -> Box, Box_2
srf = Surface(bbox_3.Box)
vec2pt = Vector2Pt(PointA=end.Start, PointB=end.End, Unitize=False)  # -> Vector, Length
area = Area(Geometry=srf)  # -> Area, Centroid
avr = Average(Input=vec2pt.Vector)
move_2 = Move(Geometry=area.Centroid, Motion=avr)  # -> Geometry, Transform
ln = Line(StartPoint=area.Centroid, EndPoint=move_2.Geometry)
vdis = VectorDisplay(Anchor=end.End, Vector=avr)
crv_4 = Curve(ln)
flip = FlipCurve(Curve=crv_3, Guide=crv_4)  # -> Curve, Flag
crv_5 = Curve(flip.Curve)

# ----
# Sort and Reduce curves
number_slider = Slider(4, range=0..20)
py3_3 = CloseCrvs(crvs=crv_5, tolerance=number_slider)  # -> out, new_crvs; inputs crvs: list of Curve, tolerance: Double
# ---------- py3_3: Python ----------
ghenv.Component.Message = "CloseCrvs"
ghenv.Component.Name = "CloseCrvs"

import Rhino.Geometry as rg

def close_curves(crvs, tolerance):
    new_crvs = []
    to_add = []

    # Create a list of start and end points
    end_points = [crv.PointAtEnd for crv in crvs]
    start_points = [crv.PointAtStart for crv in crvs]

    # Find closest points within the given tolerance
    for i, end_pt in enumerate(end_points):
        closest_dist = tolerance
        line_to_add = None

        for j, start_pt in enumerate(start_points):
            if i != j:  # avoid self-connecting
                dist = end_pt.DistanceTo(start_pt)
                if dist < closest_dist:
                    closest_dist = dist
                    line_to_add = rg.Line(end_pt, start_pt)

        # If a close enough point is found, create a line to close the curve
        if line_to_add:
            to_add.append(line_to_add)

    # Merge the original curves with the new line segments
    for crv in crvs:
        new_crvs.append(crv)

    for line in to_add:
        new_crvs.append(line.ToNurbsCurve())

    return new_crvs

# Grasshopper component code
new_crvs = close_curves(crvs, tolerance)
# ---------- end py3_3 ----------
join_3 = JoinCurves(Curves=py3_3.new_crvs, Preserve=False)
smoothpline = SmoothPolyline(Polyline=join_3, Strength=1, Times=Slider(1, range=1..5))
joined_crvs = Curve(simplify(smoothpline))

flatten = FlattenTree(Tree=joined_crvs, Path="{0}")
layer_height_3 = Data(layer_height_2)
# Module
number_slider_2 = Slider(4, range=2..8)
fluxest = FluxEstimator(profile_thickness=Slider(5.1, range=4..15), layer_height=layer_height_3, nozzle_diam=number_slider_2)  # -> out, printing_flux; inputs profile_thickness: list of Double, layer_height: Double, nozzle_diam: Double
#   port profile_thickness: Wanted printing thickness
# ---------- fluxest: Python ----------
import Grasshopper.Kernel as gh
import System.Windows.Forms as forms

ghenv.Component.Name = "Flux Estimator"
ghenv.Component.NickName = "FluxEst"
ghenv.Component.Message = "240629"

# Data from the matrices for 4mm and 8mm nozzles
data_4mm = {
    1.6: [6.39, 5.77, 5.15, 6.60, 7.23, 7.86, 8.42, 8.99, 9.55, 9.91, 9.42, 9.77, 10.28],
    1.8: [5.93, 6.80, 6.15, 6.44, 6.95, 7.30, 8.42, 8.99, 9.55, 9.91, 9.42, 9.77, 10.28],
    2.0: [5.04, 5.72, 5.61, 6.83, 7.60, 8.07, 8.42, 9.14, 9.55, 9.90, 10.20, 10.64, 10.10],
    2.2: [5.02, 6.11, 6.81, 7.30, 7.75, 8.50, 9.09, 9.72, 9.51, 9.74, 9.75, 10.23, 10.44],
    2.4: [6.00, 6.12, 6.51, 6.39, 5.50, 5.72, 7.00, 7.29, 7.78, 7.67, 7.60, 7.90, 8.18],
    2.6: [4.68, 5.30, 5.80, 6.03, 6.39, 6.70, 7.72, 8.15, 8.60, 8.99, 9.60, 9.77, 9.86],
    2.8: [3.83, 4.08, 4.14, 4.35, 5.03, 5.45, 5.72, 5.92, 6.11, 6.55, 7.20, 7.49, 7.72],
    3.0: [3.88, 4.08, 4.41, 4.69, 5.02, 5.52, 5.73, 5.92, 6.11, 6.64, 7.65, 7.72, 7.50],
    3.2: [3.90, 4.01, 4.38, 4.56, 4.77, 5.50, 5.38, 5.91, 5.92, 6.62, 6.65, 6.95, 6.77],
    3.4: [3.85, 3.93, 4.11, 4.32, 4.36, 5.05, 5.52, 5.54, 5.92, 6.42, 6.64, 7.20, 6.77],
    3.6: [3.69, 3.99, 4.15, 4.32, 4.71, 5.35, 5.52, 5.57, 5.97, 6.60, 6.60, 7.10, 7.05],
    3.8: [3.70, 4.00, 4.11, 4.45, 4.97, 5.55, 5.72, 5.92, 6.04, 6.94, 6.34, 6.34, 6.60],
}

data_8mm = {
    2: [None, None, 9.85, 11.70, 13.25, 15.55, 16.50, None, None, None, None],
    3: [None, None, 8.25, 9.50, 10.15, 12.95, 14.55, None, None, None, None],
    4: [None, None, 8.70, 9.50, 10.30, 11.60, 13.30, 15.10, 16.00, 16.00, None],
    5: [None, None, 8.45, 8.00, 8.95, 9.20, 9.20, 10.75, 11.60, 11.60, None],
    6: [None, None, None, None, 8.20, 8.70, 9.00, 9.10, 9.10, 9.60, 9.60],
    7: [None, None, 8.45, 9.25, 10.25, 10.70, None, None, None, None, None],
    8: [None, None, 8.15, 8.80, 9.30, 9.85, 10.20, 10.30, 10.20, 10.40, None],
}

flux_values_4mm = [16, 18, 20, 22, 24, 26, 28, 30, 32, 34, 36, 38, 40]
flux_values_8mm = [10, 20, 30, 40, 50, 60, 70, 80, 90, 100]

def interpolate(x, x_values, y_values):
    """
    Perform linear interpolation to estimate the y value corresponding to x.
    
    Args:
    x (float): The x value to interpolate.
    x_values (list of float): Known x values.
    y_values (list of float): Known y values.
    
    Returns:
    float: Interpolated y value.
    """
    for i in range(1, len(x_values)):
        if x < x_values[i]:
            x0, x1 = x_values[i-1], x_values[i]
            y0, y1 = y_values[i-1], y_values[i]
            return y0 + (y1 - y0) * (x - x0) / (x1 - x0)
    return y_values[-1]

def estimate_flux(thicknesses, layer_height, nozzle_diam):
    """
    Estimate the printing flux for a given list of desired thicknesses and a specific layer height.
    
    Args:
    thicknesses (list of float): Desired printing thicknesses in mm.
    layer_height (float): Layer height in mm (must be one of the keys in the data dictionary).
    nozzle_diam (float): Diameter of the nozzle used for the printing.
    
    Returns:
    list of float: Estimated printing fluxes as fractions (from 0.00 to 1.00).
    """
    # Check layer height to nozzle diameter ratio
    min_ratio = 0.2
    max_ratio = 0.8
    ratio = layer_height / nozzle_diam

    if ratio < min_ratio:
        forms.MessageBox.Show("Layer height is too low relative to nozzle diameter. It should be at least 20% of the nozzle diameter.", "Warning")
        return []
    elif ratio > max_ratio:
        forms.MessageBox.Show("Layer height is too high relative to nozzle diameter. It should not exceed 80% of the nozzle diameter.", "Warning")
        return []

    if nozzle_diam == 4:
        data = data_4mm
        flux_values = flux_values_4mm
    elif nozzle_diam == 8:
        data = data_8mm
        flux_values = flux_values_8mm
    else:
        forms.MessageBox.Show("This component only has data for 4mm and 8mm nozzles.", "Error")
        return []

    if layer_height not in data:
        raise ValueError("Invalid layer height value.")
    
    thicknesses_data = data[layer_height]
    
    # Initialize an empty list to store the flux values
    flux_list = []
    
    for thickness in thicknesses:
        valid_data = [(flux, thick) for flux, thick in zip(flux_values, thicknesses_data) if thick is not None]
        if not valid_data:
            raise ValueError(f"No valid data for layer height {layer_height} with nozzle diameter {nozzle_diam}.")
        
        flux_values_valid, thicknesses_valid = zip(*valid_data)
        
        if not (min(thicknesses_valid) <= thickness <= max(thicknesses_valid)):
            raise ValueError(f"Thickness {thickness} out of range for layer height {layer_height} with nozzle diameter {nozzle_diam}.")
        
        # Interpolating flux
        flux = interpolate(thickness, thicknesses_valid, flux_values_valid)
        flux_list.append(round(flux / 100, 2))  # Convert to a fraction between 0.00 and 1.00 and round to 2 decimals
    
    return flux_list

# Get the estimated flux list
try:
    printing_flux = estimate_flux(profile_thickness, layer_height, nozzle_diam)
except ValueError as e:
    print(e)
# ---------- end fluxest ----------

range = Range(Domain="0.3 to 0.4", Steps=expr("x-1", "67"))

genes = GenePool(Decimals=1, Maximum=1, Minimum=0.3, Value=[0.7, 0.8, 1, 0.65, 0.65, 1, 0.65, 0.65, 0.65, 0.65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])
falsestart = LBFalseStartToggle(False)

crvs_2 = Curve(flatten)

bbox_4 = BoundingBox(Content=crvs_2, Plane=PlaneXY(0, 0, 0), UnionBox=True)  # -> Box, Box_2
debrep_2 = DeconstructBrep(Brep=bbox_4.Box)  # -> Faces, Edges, Vertices
item_4 = ListItem(List=debrep_2.Vertices, Index=0, Wrap=True)
pt = Point(item_4)

py3_4 = PrintingPathOptimizer(curves=crvs_2, start_point=pt)  # -> out, optimized_path; inputs curves: list of Curve, start_point: Point3d
# ---------- py3_4: Python ----------
ghenv.Component.Name = "PrintingPathOptimizer"
ghenv.Component.Message = "240811"

""" #COPMONENT DESCRIPTION v240811
Curve Path Optimization Component for 3D Printing

This component optimizes the toolpath for 3D printing a set of input curves by sorting them to minimize travel distance. 
It uses the Nearest Neighbor heuristic to ensure that the print head moves efficiently between endpoints 
within the same layer and transitions optimally between different layers. 
The process starts at a user-specified reference point, ensuring the path begins at a 
designated start position.

The optimization happens in two stages:

Layer Organization: Curves are grouped by their Z-height into layers to process each layer separately. This grouping considers a tolerance level to account for minor variations in Z-heights.
Intra-Layer Optimization: Within each layer, curves are sorted to minimize the end-to-start travel for consecutive curves.
Inter-Layer Transitions: After sorting within a layer, the algorithm identifies the shortest move to the next layer's starting curve, considering Z-height transitions.
The output is a sequence of curves ordered to provide an effective and time-efficient 3D printing path.
"""
import Rhino.Geometry as rg
import scriptcontext as sc

def sort_curves_nearest_neighbor(curves, start_point):
    if not curves:
        return []
    
    sorted_curves = []
    unvisited = curves[:]
    
    # Find the curve closest to the start_point
    closest_curve_index = None
    closest_distance = float('inf')
    for i, curve in enumerate(unvisited):
        d_start = start_point.DistanceTo(curve.PointAtStart)
        d_end = start_point.DistanceTo(curve.PointAtEnd)
        if min(d_start, d_end) < closest_distance:
            closest_curve_index = i
            closest_distance = min(d_start, d_end)
            flip = d_start > d_end
    
    # Flip the curve if needed and set it as the first curve
    if flip:
        unvisited[closest_curve_index].Reverse()
    sorted_curves.append(unvisited.pop(closest_curve_index))
    current_point = sorted_curves[-1].PointAtEnd
    
    # Continue with the nearest neighbor algorithm
    while unvisited:
        closest_curve_index = None
        closest_distance = float('inf')
        for i, curve in enumerate(unvisited):
            d_start = current_point.DistanceTo(curve.PointAtStart)
            d_end = current_point.DistanceTo(curve.PointAtEnd)
            if min(d_start, d_end) < closest_distance:
                closest_curve_index = i
                closest_distance = min(d_start, d_end)
                flip = d_start > d_end
        
        # Flip the curve if the end point is closer
        if flip:
            unvisited[closest_curve_index].Reverse()
        
        # Append the closest curve and update the current point
        sorted_curves.append(unvisited.pop(closest_curve_index))
        current_point = sorted_curves[-1].PointAtEnd
    
    return sorted_curves

def group_curves_by_layer(curves, tolerance=0.01):
    layers = {}
    for curve in curves:
        z_value = round((curve.PointAtStart.Z + curve.PointAtEnd.Z) / 2, 2)
        layer_key = round(z_value / tolerance) * tolerance
        if layer_key not in layers:
            layers[layer_key] = []
        layers[layer_key].append(curve)
    return layers

def sort_curves_within_layers(curves_by_layer, start_point):
    sorted_layers = {}
    for z, layer_curves in sorted(curves_by_layer.items()):
        sorted_layers[z] = sort_curves_nearest_neighbor(layer_curves, start_point)
        # Update the start point for the next layer to the end of the last curve
        if sorted_layers[z]:
            start_point = sorted_layers[z][-1].PointAtEnd
    return sorted_layers

def optimize_path_across_layers(sorted_layers):
    optimized_path = []
    for z, layer_curves in sorted_layers.items():
        optimized_path.extend(layer_curves)
    return optimized_path
"""
# Get the curves and start point from the Grasshopper inputs
curves = # ... assume this is filled with the input curves from Grasshopper
start_point = # ... assume this is filled with the input start point from Grasshopper
"""
# Process the optimization
curves_by_layer = group_curves_by_layer(curves)
sorted_curves_within_layers = sort_curves_within_layers(curves_by_layer, start_point)
optimized_path = optimize_path_across_layers(sorted_curves_within_layers)

# The output to Grasshopper
optimized_path
# ---------- end py3_4 ----------
sorted_curves = Curve(py3_4.optimized_path)

nozzle_diam_4 = Number(nozzle_diam_2)
division_3 = Division(A=nozzle_diam_4, B="2")
crv_6 = Curve(crvs_2)
crv_7 = Curve(sorted_curves)
divlength = DivideLength(Curve=crv_6, Length=division_3)  # -> flatten(Points), Tangents, Parameters
divlength_2 = DivideLength(Curve=crv_7, Length=division_3)  # -> flatten(Points), Tangents, Parameters
pline = PolyLine(Vertices=divlength.Points, Closed=False)
pline_2 = PolyLine(Vertices=divlength_2.Points, Closed=False)
len_2 = Length(Curve=pline)
len_3 = Length(Curve=pline_2)
split = SplitList(List=flatten(divlength_2.Points), Index=Slider(5000, range=1..5000))  # -> ListA, ListB
division_4 = Division(A=len_2, B="3600")
division_5 = Division(A=len_3, B="3600")
data_3 = Data(split.ListA)
panel_2 = Panel(division_4)
panel_3 = Panel(division_5)
division_6 = Division(A=division_5, B=division_4)
panel_4 = Panel(division_6)

split_2 = SplitList(List=flatten(sorted_curves), Index=Slider(112, range=0..1000))  # -> ListA, ListB
data_4 = Data(split_2.ListA)
data_5 = Data(sorted_curves)

# ----
# Create G-Code
panel_5 = Panel("0.3")
printing_path_crvs = Data(flatten(data_5))
layer_height_4 = Data(layer_height_3)
py3_5 = GcodeGenerationLDM(
    printing_path=printing_path_crvs,
    nozzle_diameter="3",
    printing_speed="3600",
    printing_flux=panel_5,
    layer_h=layer_height_4)  # -> out, g_code, printing_points, printing_speed, printing_time, printing_path_len, layers; inputs printing_path: list of Curve, nozzle_diameter: Double, printing_speed: Double, printing_flux: list of Double, layer_h: Double
# ---------- py3_5: Python ----------
ghenv.Component.Name = "Gcode Generation LDM"
ghenv.Component.Message = "240811"

#region COMPONENT DESCRIPTION
""" COMPONENT DESCRIPTION 240811
Gcode Generation LDM

This script generates G-code for 3D printing based on a set of 3D curves representing the toolpaths
for each layer of a print. The script outputs a G-code file that directs the printer's movements,
controls extrusion, and manages layer transitions.

Inputs:
    printing_path (List of Curves):
        A list of 3D curves that define the path the 3D printer head will follow for each layer
        of the print. Each curve corresponds to a segment of the printing path for a specific layer.

    nozzle_diameter (Float):
        The diameter of the 3D printer's nozzle, in millimeters. This value is used to determine
        the spacing between points along each curve in the toolpath.

    printing_speed (Float):
        The speed at which the printer head moves while extruding material, specified in millimeters
        per minute (mm/min). The script validates that the speed is within a typical operational range
        (1800 to 11000 mm/min).

    printing_flux (Float or List of Floats):
        A value or list of values that specify the extrusion rate as a percentage for each layer.
        If a single value is provided, it is used for all layers. If a list is provided, each value
        corresponds to a specific layer. The script ensures the list length matches the number
        of layers in the print.

    layer_h (Float):
        The height of each layer in the print, specified in millimeters. This value is used to
        determine the Z-coordinate for each layer and to manage layer transitions.

Outputs:
    gcode (List of Strings):
        The generated G-code commands as a list of strings. This includes all movement, extrusion,
        and retraction commands, as well as start and end G-code blocks, and comments indicating
        the start and end of each layer.

    printing_time (String):
        The estimated time required to complete the print, calculated based on the total length of
        the toolpath and the specified printing speed. The output is formatted as a string in minutes.

    printing_points (List of Points):
        A list of all the points generated along the curves in the toolpath. These points represent
        the exact positions the printer head will move to during the print.

    printing_path_len (String):
        The total length of the printing path in millimeters, formatted as a string.

    layers (Integer):
        The total number of layers in the print, calculated based on the height of the curves
        and the specified layer height.
"""
#endregion

import Rhino.Geometry as rg
import rhinoscriptsyntax as rs
from collections import defaultdict

def generate_gcode(printing_path, nozzle_diameter, printing_speed, printing_flux, layer_h, retract=True):
    # Validate printing speed
    if printing_speed < 1800 or printing_speed > 11000:
        rs.MessageBox("Warning: Printing speed must be between 1800 and 11000 mm/minute.", 0, "Speed Warning")
        return None, None, None, None, None
    
    # Ensure printing_flux is a list, even if a single value is provided
    if not isinstance(printing_flux, list):
        printing_flux = [printing_flux]
    
    # Calculate the number of layers
    max_z = max(curve.PointAtEnd.Z for curve in printing_path)
    num_layers = int(max_z / layer_h) + 1
    
    # Check if the length of printing_flux matches the number of layers
    if len(printing_flux) != 1 and len(printing_flux) < num_layers:
        rs.MessageBox("Warning: The number of flux values does not match the number of layers.", 0, "Flux Mismatch")
        return None, None, None, None, num_layers

    # Group curves by layer
    curves_by_layer = defaultdict(list)
    for curve in printing_path:
        if curve.IsValid and curve.GetLength() > 0:
            layer_index = int(curve.PointAtEnd.Z / layer_h)
            curves_by_layer[layer_index].append(curve)
    
    # Initialize the G-code list and points list
    gcode = []
    printing_points = []
    total_extrusion_distance = 0.0
    total_travel_distance = 0.0  # To store travel distance
    extrusion_amount = 0.0  # Initialize the total extrusion amount
    
    # Start G-code with printing information
    printing_info = [
        ";PRINTING INFORMATION:",
        f";Printing speed: {printing_speed} [mm/min]",
        f";Nozzle diameter: {nozzle_diameter} [mm]",
        f";Number of layers: {num_layers}",
        f";Layer height: {layer_h} [mm]",
        "; -- START GCODE --",
        "G90",  # Absolute positioning
        "M82",  # Set extruder to absolute mode
        "G28",  # Home all axes
        "G92 E0.0000",  # Reset extruder position
        "G1 E-4.0000 F6000",  # Retract filament
        "G1 Z2.000 F12000",  # Move Z-axis
        "; -- END OF START GCODE --"
    ]
    gcode.extend(printing_info)
    
    previous_point = None  # Keep track of the end point of the previous curve
    
    # Iterate through each layer and generate G-code
    for layer_index in sorted(curves_by_layer.keys()):
        # Start of the layer
        gcode.append(f"; Start of layer {layer_index + 1}")
        current_flux = printing_flux[0] if len(printing_flux) == 1 else printing_flux[min(layer_index, len(printing_flux) - 1)]
        
        for curve in curves_by_layer[layer_index]:
            # Divide the curve by the specified segment length
            curve_params = curve.DivideByLength(nozzle_diameter / 2, True)
            if curve_params is None:
                continue
            
            # Create points for each segment
            points = [curve.PointAt(t) for t in curve_params]
            points.insert(0, curve.PointAtStart)
            points.append(curve.PointAtEnd)
            
            for i, pt in enumerate(points):
                if i > 0:  # Skip the first point, as it's only for moving to the start
                    segment_distance = points[i - 1].DistanceTo(pt)
                    total_extrusion_distance += segment_distance
                    extrusion_amount += segment_distance * current_flux
                    gcode_line = f"G1 F{printing_speed:.0f} X{pt.X:.4f} Y{pt.Y:.4f} Z{pt.Z:.4f} E{extrusion_amount:.4f}"
                    gcode.append(gcode_line)
                    printing_points.append(pt)
            
            # Calculate travel distance if there is a previous point
            if previous_point:
                travel_distance = previous_point.DistanceTo(points[0])
                total_travel_distance += travel_distance

            previous_point = points[-1]
        
        # Handle retraction after finishing a curve only if retract is explicitly True
        if bool(retract):
            last_point = points[-1]
            retract_gcode = f"G1 F{printing_speed:.0f} Z{last_point.Z + layer_h:.4f} ; Retract to avoid pulling"
            gcode.append(retract_gcode)
            previous_point.Z += layer_h  # Update the previous point's Z height to account for retraction
        
        # End of the layer
        gcode.append(f"; End of layer {layer_index + 1}")
    
    # End G-code
    end_gcode = [
        "; -- END GCODE --",
        "G92 E0.0000",  # Reset extruder position
        "G1 E-4.0000 F6000",  # Retract filament
        "G28",  # Home all axes
        "; -- END OF END GCODE --"
    ]
    gcode.extend(end_gcode)

    # Calculate total length for printing time calculation
    total_length = total_extrusion_distance + total_travel_distance
    printing_time_minutes = total_length / printing_speed if total_length else 0
    printing_time = f"{printing_time_minutes:.2f} minutes"

    # Outputs for Grasshopper
    printing_path_len =  f"{total_extrusion_distance:.2f} mm"
    printing_speed = f"{printing_speed:.0f} mm/min"
    layers = num_layers

    # Return the list of G-code lines, and the other outputs
    return gcode, printing_time, printing_points, printing_path_len, layers

# Example usage with retract option defaulting to True
g_code, printing_time, printing_points, printing_path_len, layers = generate_gcode(printing_path, nozzle_diameter, printing_speed, printing_flux, layer_h)
# ---------- end py3_5 ----------
number_slider_3 = Slider(1, range=0.01..1)
panel_6 = Panel(py3_5.printing_time)
points = Data(py3_5.printing_points)
panel_7 = Panel(py3_5.layers)
gcode = Data(py3_5.g_code)

g_code = Data(gcode)

# ----
# Save G-Code
panel_8 = Panel("Path...")
# Resolution from voxel size
# Thicken Iso - Axoltl
boolean_toggle = BooleanToggle(False)
file_path = FilePath(panel_8)
gcode_2 = Data(g_code)
py3_6 = SaveGCode(
    g_code=gcode_2,
    file_path=file_path,
    file_name="DF_Vase_3_Fuzzy",
    file_extension=".gcode",
    run=falsestart,
    override=boolean_toggle)  # -> out; inputs g_code: list, run: Boolean, override: Boolean
# ---------- py3_6: Python ----------
ghenv.Component.Name = "Save G-Code"
ghenv.Component.Message = "240811"

#region COMPONENT DESCRIPTION 240811
"""
Component Name: Save G-Code
Component Version: 240811

Description:
This component saves a list of G-code strings to a specified file location on your system. 
It provides functionality to name the file, choose a file extension (such as .gcode), 
and decide whether to override an existing file. The component is particularly useful 
for finalizing and exporting G-code after generating it with Grasshopper-based 3D printing workflows.

Inputs:
- g_code: (List of Strings) The G-code lines that you want to save to a file.
- file_path: (String) The directory path where the file will be saved.
- file_name: (String) The desired name of the file, without the extension.
- file_extension: (String) The desired file extension, such as .gcode.
- run: (Boolean) Triggers the file-saving operation. When set to True, the file is saved.
- override: (Boolean) Determines whether an existing file with the same name should be overwritten. 
  If False and the file exists, a warning is displayed and the file is not saved.

Outputs:
- out: (None) This component does not produce an output, but it will display a message confirming the save 
  or showing an error if something goes wrong.

Usage:
1. Connect the G-code list to the g_code input.
2. Specify the directory path and file name using the file_path and file_name inputs.
3. Choose a file extension (e.g., .gcode).
4. Set run to True to save the file.
5. If you want to overwrite an existing file, set override to True.

Error Handling:
- If the file already exists and override is set to False, a message box will appear warning that the file was not saved.
- Any exceptions during the file-writing process will be printed in the console.
"""
#endregion

import os
import rhinoscriptsyntax as rs

# Inputs
g_code = g_code  # List of strings (G-code)
file_path = file_path  # Full directory path
file_name = file_name  # Desired file name without extension
file_extension = file_extension  # Desired file extension (e.g., ".gcode")
run = run  # Boolean to trigger saving
override = override  # Boolean to allow file override

# Initialize output
out = None

if run:
    # Construct the full file path
    full_file_path = os.path.join(file_path, file_name + file_extension)
    
    # Check if the file exists and if override is allowed
    if not os.path.exists(full_file_path) or override:
        try:
            # Write the G-code to the file
            with open(full_file_path, 'w') as file:
                for line in g_code:
                    file.write(line + '\n')
            print(f"File {file_name} saved successfully at {full_file_path}")
        except Exception as e:
            print(f"Error: {str(e)}")
    else:
        # Show a message box warning about the file already existing and override set to False
        rs.MessageBox(f"The file '{file_name}' already exists in the directory '{file_path}'. Please set override to True or change the file's name. No file was saved.", 0, "File Save Warning")
# ---------- end py3_6 ----------
panel_9 = Panel(py3_6)
